% Simulink data dictionary Hbridge.sldd

TTL_on = Simulink.Parameter(2, DataType="double", Unit="V")  % Nível de tensão alta para saídas TTL.
Va_batt = Simulink.Parameter(336, DataType="double", Unit="V")  % Tensão máxima do pack de bateriais da alimentação da ponte H.