% Simulink data dictionary PIDControl.sldd

Kd = Simulink.Parameter([])
Ts_PID = Simulink.Parameter(0.001, DataType="double", Unit="s")
w_max = Simulink.Parameter(534.0708, DataType="double", Unit="rad/s")  % Máxima velocidade do motor em regime permanente
Kp = Simulink.Parameter(0.00488938, DataType="double")
Ki = Simulink.Parameter(0.977876, DataType="double")
N = Simulink.Parameter(100, DataType="double")