% Simulink data dictionary PwmGenerator.sldd

TTL_amplitude = Simulink.Parameter(5, DataType="double", Min=0, Max=5, Unit="V")  % Amplitude do sinal lógico PWM, relacionada ao sistema embarcado na fase de deploy.
T_DELAY = Simulink.Parameter(0, DataType="double")
TS = Simulink.Parameter(0.0001, DataType="double", Unit="sec")
PWM_FREQ = Simulink.Parameter(1000, DataType="double", Unit="Hz")  % Frequencia do PWM do controlador.