% Simulink data dictionary System.sldd
% references DcMotor.sldd
% references Hbridge.sldd
% references PIDControl.sldd
% references PwmGenerator.sldd

CAN_MESSAGE_BUS = Simulink.Bus()
  Extended: uint8
  Length: uint8
  Remote: uint8
  Error: uint8
  ID: uint32
  Timestamp: double
  Data: uint8[8]

DeployNVIDIA = Simulink.ConfigSet(StartTime="0", StopTime="inf", FixedStep="1e-3", Solver="FixedStepAuto", ProdHWDeviceType="ARM Compatible->ARM Cortex-A (64-bit)", SystemTargetFile="ert.tlc", HardwareBoard="NVIDIA Jetson", TargetLang="C")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