% Simulink data dictionary Vechicle1Dof.sldd

Af_vehicle = Simulink.Parameter(0.15, DataType="double", Min=0, Unit="m*m")  % Área frontal do veículo
d_transmission = Simulink.Parameter(0.1, DataType="double", Min=0, Unit="m")  % Distância média da transmissão do veículo. Distância entre o ponto de aplicação da força ao eixo de rotação.
M_vehicle = Simulink.Parameter(100, DataType="double", Min=0, Unit="kg")  % Massa total do veículo.