# Requirement set ControlRequirements (R2025a)

## 1 [MOT_CTRL-CTRL-INF-001] Controle de velocidade do motor via ação PID (Informational)
O controlador deve regular a velocidade angular do motor utilizando uma estratégia de controle PID (Proporcional, Integral, Derivativo), com a entrada sendo o erro entre a referência e a velocidade medida.
Rationale: A estratégia PID oferece uma solução eficaz para controle de sistemas com dinâmica simples, permitindo ajuste fino da resposta do motor à referência desejada.

## 2 [MOT_CTRL-CRTL-INF-002] Tempo de atualização do controle (Informational)
O controlador PID deve ser executado com uma taxa de amostragem fixa de 10 ms, compatível com a taxa de atualização do sistema.
Rationale: Uma taxa de atualização consistente é fundamental para garantir estabilidade do controle e sincronismo com os outros subsistemas, como geração PWM e leitura de sensores.

## 3 [MOT_CTRL-CRTL-FUN-003] Saturação na saída do controlador
A saída do controlador PID deve ser limitada ao intervalo [0, 1] antes de ser aplicada à modulação PWM.
Rationale: Previne que a saída do controle ultrapasse os limites físicos da entrada do gerador PWM, evitando distorções ou comportamento indesejado.

## 4 [MOT_CTRL-CRTL-FUN-004] Resposta ao degrau
O tempo de estabilização deve ser até 5 segundos.