# Requirement set PWMRequirements (R2025a)

## 1 [MOT_CTRL_PWM_FUN_001] Geração PWM
O sinal PWM deve variar continuamente entre 0 e 5 com precisão double.
Rationale: Garantir a adequada resolução dos valores do PWM.

## 2 [MOT_CTRL_PWM_FUN_002] Frequência do sinal PWM
A frequência do sinal PWM deve ser de 1 kHz, com tolerância de 2%.
Rationale: Garantir a resposta do filtro passa baixa na saída da ponte H.

## 3 [MOT_CTRL_PWM_FUN_003] SInal compatível com nível TTL
A onda do sinal PWM deve ter amplitude conforme padrao TTL.
Rationale: Garantir o nível de tensão correta na interface com o driver do motor.