test file "DcMotorTests"

suite "MOT_CTRL-MOT-FUN"

  case "MOT_CTRL-MOT-FUN-001" [baseline]
    description: Esse modelo implementa o teste de relação entre tensão de alimentação da armadura do motor e velocidade angular no eixo.
    model DcMotorSimulink, harness MOT_CTRL_MOT_FUN_001
    assessment "VoltageSpeedRelationship": At any point of time, whenever t > 1.0001 is true then, with no delay, result_sim == true must be true
      result_sim: signal MOT_CTRL_MOT_FUN_001/Test Sequence, port 1

  case "MOT_CTRL-MOT-FUN-002" [baseline]
    description: Verifica se o tempo de resposta do modelo à um degrau satisfaz as condições estabelecidas no requisito MOT_CTRL-MOT-FUN-002.
    model DcMotorSimulink, harness MOT_CTRL_MOT_FUN_002
    assessment "StepResponse": At any point of time, whenever t > 1.25 is true then, with no delay, result_simulation == true must be true
      result_simulation: signal MOT_CTRL_MOT_FUN_002/Test Assessment, port 1

  case "MOT_CTRL-MOT-FUN-003" [baseline]
    description: Verifica se a velocidade do motor, em regime estacionário, está dentro dos limites para todas as condições de entrada.
    model DcMotorSimulink, harness MOT_CTRL_MOT_FUN_003
    assessment "CheckSpeedRange": At any point of time, result_sim == true must be true
      result_sim: signal MOT_CTRL_MOT_FUN_003/Test Assessment, port 1