test file "HBridge"

suite "MOT_CTRL_PTH_FUN"

  case "MOT_CTRL_PTH_FUN_001_1" [baseline]
    description: A tensão chaveada na saída deve ser positiva quando o sinal de controle for positivo (forward).
    model HBridgeLut, harness MOT_CTRL_PTH_FUN_001_1
    assessment "CheckPosVoltage": At any point of time, whenever flag is true then, with no delay, result must be true
      flag: signal MOT_CTRL_PTH_FUN_001_1/Test Sequence, port 3
      result: signal MOT_CTRL_PTH_FUN_001_1/Test Assessment, port 1

  case "MOT_CTRL_PTH_FUN_001_2" [baseline]
    description: A tensão chaveada na saída deve ser positiva quando o sinal de controle for negativo (backward).
    model HBridgeLut, harness MOT_CTRL_PTH_FUN_001_2
    assessment "CheckNegVoltage": At any point of time, whenever flag is true then, with no delay, result must be true
      flag: signal MOT_CTRL_PTH_FUN_001_2/Test Sequence, port 3
      result: signal MOT_CTRL_PTH_FUN_001_2/Test Assessment, port 1

  case "MOT_CTRL_PTH_FUN_002_1" [baseline]
    description: A ponte H deve realizar a transição completa do estado desligado para o estado direto em até 250 ms.
    model HBridgeLut, harness MOT_CTRL_PTH_FUN_002_1
    assessment "CheckSwitchingTime": At any point of time, whenever flag is true then, with a delay of at most 0.25, result must be true
      flag: signal MOT_CTRL_PTH_FUN_002_1/Test Sequence1, port 3
      result: signal MOT_CTRL_PTH_FUN_002_1/Test Assessment, port 1

  case "MOT_CTRL_PTH_FUN_002_2" [baseline]
    description: A ponte H deve realizar a transição completa do estado desligado para o estado reverso em até 250 ms.
    model HBridgeLut, harness MOT_CTRL_PTH_FUN_002_2
    assessment "CheckSwitchingTime": At any point of time, whenever flag is true then, with a delay of at most 0.25, result must be true
      flag: signal MOT_CTRL_PTH_FUN_002_2/Test Sequence, port 3
      result: signal MOT_CTRL_PTH_FUN_002_2/Test Assessment, port 1

  case "MOT_CTRL_PTH_FUN_003_1" [baseline]
    description: A tensão de saída da ponte H aplicada ao motor deve próxima de 336 V no sentido direto, com toletância de 5%.
    model HBridgeLut, harness MOT_CTRL_PTH_FUN_003_1
    assessment "CheckStaticGap": At any point of time, whenever flag is true then, with a delay of at most 0.25, result must be true
      flag: signal MOT_CTRL_PTH_FUN_003_1/Test Sequence, port 3
      result: signal MOT_CTRL_PTH_FUN_003_1/Test Assessment, port 1

  case "MOT_CTRL_PTH_FUN_003_2" [baseline]
    description: A tensão de saída da ponte H aplicada ao motor deve próxima de 336 V no sentido reverso, com toletância de 5%.
    model HBridgeLut, harness MOT_CTRL_PTH_FUN_003_2
    assessment "CheckStaticGap": At any point of time, whenever flag is true then, with a delay of at most 0.25, result must be true
      flag: signal MOT_CTRL_PTH_FUN_003_2/Test Sequence, port 3
      result: signal MOT_CTRL_PTH_FUN_003_2/Test Assessment, port 1