test file "PIDControl"

suite "MOT_CTRL_CTRL_FUN"

  case "MOT_CTRL_CTRL_FUN_003" [baseline]
    description: Este teste vaida os limites da saída do controlador. Foi utilizado um degrau, que inicia no menor setpoint para testar o limite inferior, e termina em um setpoint maior que a velocidade do motor, validando se o controlador irá saturar no máximo.
    model PIDAdj, harness MOT_CTRL_CTRL_FUN_003
    assessment "CheckControlValues": At any point of time, whenever true is true then, with no delay, result must be true
      result: signal Test_harness_MOT_CTRL_CRTL_FUN_003/Test Assessment, port 1

  case "MOT_CTRL_CTRL_FUN_004" [baseline]
    description: Este teste vaida o tempo de estabilização da resposta a um degrau, utilizando o critério de 2% para o erro em regime permanente.
    model PIDAdj, harness MOT_CTRL_CTRL_FUN_004
    assessment "CheckSettlingTime": At any point of time, whenever flag is true then, with no delay, result must be true
      flag: signal Test_harness_MOT_CTRL_CRTL_FUN_004/Test Sequence, port 2
      result: signal Test_harness_MOT_CTRL_CRTL_FUN_004/Test Assessment, port 1