test file "PwmGeneration"

suite "MOT_CTRL_PWM_FUN"

  case "MOT_CTRL_PWM_FUN_001" [baseline]
    description: Teste do gerador de sinal PWM, de acordo com os requisitos MOT_CTRL_PWM_FUN_001 . Este teste vaida a precisão do sinal PWM.
    model PwmGenerator, harness MOT_CTRL_PWM_FUN_001
    assessment "DataTypeVerification": At any point of time, whenever true is true then, with a delay of at most 1e-4, result_simulation == true must be true
      result_simulation: signal MOT_CTRL_PWM_FUN_001/Test Assessment, port 1

  case "MOT_CTRL_PWM_FUN_002" [baseline]
    description: Teste do gerador de sinal PWM de acordo com os requisitos MOT_CTRL_PWM_FUN_002. Este teste vaida a frequência do sinal de PWM, com tolerância de 2%. Escolheu-se um valor de ciclo de trabalho fixo em 50%, que é suficiente para validar a análise no espectro da frequência, pois a onda é de período fixo em 1 [ms]. Adiciou-se um delay de 1 segundo para que o processador de sinal responda.
    model PwmGenerator, harness MOT_CTRL_PWM_FUN_002
    assessment "FrequencyAnalysis": At any point of time, whenever flag == true is true then, with no delay, result_simulation == true must be true
      flag: signal MOT_CTRL_PWM_FUN_002/frequence_measurement/Cast To Boolean, port 1
      result_simulation: signal MOT_CTRL_PWM_FUN_002/frequence_measurement, port 1

  case "MOT_CTRL_PWM_FUN_003" [baseline]
    description: Teste para verificar se o nível de tensão para a saída PWM está de acordo com o intervalo do nível de tensão TTL.
    model PwmGenerator, harness MOT_CTRL_PWM_FUN_003
    assessment "CheckTTLVoltageLevel": At any point of time, result_simulation == true must be true
      result_simulation: signal MOT_CTRL_PWM_FUN_003/OR2, port 1